# Grasshopper definition daylighting_gen.gh (Grasshopper 1.0.7)

panel = Panel("website")  # disabled
geometry = Geometry([<brep referenced from the Rhino model> x2])  # disabled
geometry_2 = Geometry([<brep referenced from the Rhino model> x5])  # disabled
geometry_3 = Geometry(<brep referenced from the Rhino model>)  # disabled
roomsolid = HBRoomFromSolid(geo=flatten(geometry_3), conditioned=True)  # -> out, rooms; disabled; plug-in component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
aperture = HBAperture(geo=geometry_2)  # -> out, apertures; disabled; plug-in component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
face = HBFace(geo=geometry)  # -> out, faces; disabled; plug-in component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
downloadepw = LBDownloadWeather(weather_URL=panel)  # -> epw_file, stat_file, ddy_file; disabled; plug-in component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
bordershades = HBExtrudedBorderShades(hb_objs=flatten(aperture.apertures))  # -> out, hb_objs; disabled; plug-in component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
wea = HBWeaFromEPW(epw_file=downloadepw.epw_file)  # -> wea; disabled; plug-in component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
addsubface = HBAddSubface(hb_obj=flatten(roomsolid.rooms), sub_faces=flatten(bordershades.hb_objs))  # -> hb_obj; disabled; plug-in component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
model = HBModel(rooms=flatten(addsubface), faces=flatten(face.faces))  # -> out, model; disabled; plug-in component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
gridrooms = HBSensorGridFromRooms(rooms=model.model)  # -> grid, points, mesh; disabled; plug-in component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
assigngridsviews = HBAssignGridsAndViews(model=model.model, grids=flatten(gridrooms.grid))  # -> model; disabled; plug-in component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
annualdaylight = HBAnnualDaylight(model=assigngridsviews, wea=wea)  # -> out, results, DA, cDA, UDI, UDI_low, UDI_up; disabled; plug-in component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
legendpar = LBLegendParameters()  # -> leg_par; disabled; plug-in component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
mesh_join = MeshJoin(Meshes=gridrooms.mesh)  # disabled
data = Data(flatten(annualdaylight.DA))  # disabled
heatmap = LBSpatialHeatmap(values=data, mesh=mesh_join, legend_par=legendpar)  # -> mesh, legend, title, colors, legend_par; disabled; plug-in component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
sda = HBSpatialDaylightAutonomy(DA=data, mesh=mesh_join)  # -> out, sDA, pass_fail; disabled; plug-in component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
